# Grasshopper definition RiRhino.gh (Grasshopper 1.0.7)

# ---- group: Sending Point
c_script = CSharpScript()  # -> Receive_pt
# ---------- c_script: C# ----------
    Receive(Component);

    Receive_pt = pt;
# ---------- c_script: C# additional code ----------
  Point3d pt;
  bool registered = false;
  IGH_Component comp = null;

  void Receive(IGH_Component component)
  {
    if(!registered)
    {
      Rhino.Runtime.HostUtils.RegisterNamedCallback("ToRiR_pt", RiRhino);

      comp = component;
      registered = true;
    }
  }

  void RiRhino(object sender, Rhino.Runtime.NamedParametersEventArgs args)
  {
    Rhino.Geometry.Point3d values;
    if (args.TryGetPoint("point", out values))
    {
      pt = values;
    }

    comp.ExpireSolution(true);
  }
# ---------- end c_script ----------
panel = Panel(c_script)
pt = ConstructPoint(XCoordinate=Slider(10, range=0..10), YCoordinate=Slider(10, range=0..10), ZCoordinate=Slider(10, range=0..10))
c_script_2 = CSharpScript(Send_pt=pt)  # inputs Send_pt: Point3d
# ---------- c_script_2: C# ----------
    using(var args = new Rhino.Runtime.NamedParametersEventArgs())
    {
      args.Set("point", new Point3d(Send_pt));
      Rhino.Runtime.HostUtils.ExecuteNamedCallback("ToRiR_pt", args);
    }
# ---------- end c_script_2 ----------

# ---- group: Sending String
c_script_3 = CSharpScript()  # -> Receive_str
# ---------- c_script_3: C# ----------
    Receive(Component);

    Receive_str = str;
# ---------- c_script_3: C# additional code ----------
  string str;
  bool registered = false;
  IGH_Component comp = null;

  void Receive(IGH_Component component)
  {
    if(!registered)
    {
      Rhino.Runtime.HostUtils.RegisterNamedCallback("ToRiR_str", RiRhino);

      comp = component;
      registered = true;
    }
  }

  void RiRhino(object sender, Rhino.Runtime.NamedParametersEventArgs args)
  {
    string values;
    if (args.TryGetString("str", out values))
    {
      str = values;
    }

    comp.ExpireSolution(true);
  }
# ---------- end c_script_3 ----------
panel_2 = Panel(c_script_3)
c_script_4 = CSharpScript(Send_str="Hello World!!")  # inputs Send_str: String
# ---------- c_script_4: C# ----------
    using(var args = new Rhino.Runtime.NamedParametersEventArgs())
    {
      args.Set("str", Send_str);
      Rhino.Runtime.HostUtils.ExecuteNamedCallback("ToRiR_str", args);
    }
# ---------- end c_script_4 ----------
