# Grasshopper definition callunity2.gh (Grasshopper 1.0.7)

receive = CSharpScript()  # -> A
# ---------- receive: C# ----------
    Register(Component);

    A = pt;
# ---------- receive: C# additional code ----------
  Point pt = null;
  bool registered = false;
  IGH_Component comp = null;

  void Register(IGH_Component component)
  {
    if(!registered)
    {
      Rhino.Runtime.HostUtils.RegisterNamedCallback("ToGrasshopper2", ToGrasshopper);

      comp = component;

      registered = true;
    }
  }

  void ToGrasshopper(object sender, Rhino.Runtime.NamedParametersEventArgs args)
  {
    Rhino.Geometry.GeometryBase[] values;
    if (args.TryGetGeometry("point_box", out values))
      pt = values[0] as Rhino.Geometry.Point;

    comp.ExpireSolution(true);
  }
# ---------- end receive ----------

# ---- group: Use to prototype behavior when not running Rhino.Inside.Unity
pt = Point(Point(6.475392149, -23.55799914, 14.47947842))  # disabled
c_script = CSharpScript(pt=pt)  # -> out, A; inputs pt: Point3d; disabled
# ---------- c_script: C# ----------
    using (var args = new Rhino.Runtime.NamedParametersEventArgs())
    {
      args.Set("point", new Point(pt));
      Rhino.Runtime.HostUtils.ExecuteNamedCallback("ToGrasshopper", args);
    }
# ---------- end c_script ----------

# ---- group: Receives "Main Camera" location from Unity
receive_2 = CSharpScript()  # -> A
# ---------- receive_2: C# ----------
    Register(Component);

    A = pt;
# ---------- receive_2: C# additional code ----------
  Point pt = null;
  bool registered = false;
  IGH_Component comp = null;

  void Register(IGH_Component component)
  {
    if(!registered)
    {
      Rhino.Runtime.HostUtils.RegisterNamedCallback("ToGrasshopper", ToGrasshopper);

      comp = component;

      registered = true;
    }
  }

  void ToGrasshopper(object sender, Rhino.Runtime.NamedParametersEventArgs args)
  {
    Rhino.Geometry.GeometryBase[] values;
    if (args.TryGetGeometry("point", out values))
      pt = values[0] as Rhino.Geometry.Point;

    comp.ExpireSolution(true);
  }
# ---------- end receive_2 ----------

# ----
panel = Panel(receive)
pdecon = Deconstruct(Point=receive)  # -> XComponent, YComponent, ZComponent
box = CenterBox(Base=PlaneXY(0, 0, 0), X=pdecon.XComponent, Y=pdecon.YComponent, Z=pdecon.ZComponent)
panel_2 = Panel(receive_2)
pop3d = Populate3D(Region=box, Count=100, Seed=1)
pt_2 = ConstructPoint(XCoordinate=0, YCoordinate=0, ZCoordinate=0)
vec2pt = Vector2Pt(PointA=pt_2, PointB=pop3d, Unitize=invert(False))  # -> Vector, Length
dist = Distance(PointA=receive_2, PointB=pop3d)
remap = RemapNumbers(Value=dist, Source=" 0 to 200", Target="1 to 0")  # -> Mapped, Clipped
graph = GraphMapper(remap.Mapped, x0=0, x1=1, y0=0, y1=1, container_name="Bezier", cpx=[0, 0.8358897567, 0.3380215466, 1], cpy=[0, 0, 1, 1])
multiplication = Multiplication(A=graph, B="50")
amp = Amplitude(Vector=vec2pt.Vector, Amplitude=multiplication)
addition = Addition(A=pop3d, B=amp)
msphere = MeshSphere(Base=addition, Radius=10, UCount=10, VCount=20)
mjoin = MeshJoin(Meshes=msphere)

# ---- group: Pass data back to Unity
c_script_2 = CSharpScript(mesh=mjoin)  # inputs mesh: Mesh
# ---------- c_script_2: C# ----------
    using(var args = new Rhino.Runtime.NamedParametersEventArgs())
    {
      args.Set("mesh", mesh);
      Rhino.Runtime.HostUtils.ExecuteNamedCallback("Unity:FromGrasshopper", args);
    }
# ---------- end c_script_2 ----------
